test file "Control_TestFile"
  coverage: Decision

suite "Test Suite 1"

  case "Test Case 1 Unit Test MIL Control" [baseline]
    model Control, harness Control_Harness1, mode Normal

  case "Test Case 2 Unit Test SIL Control" [baseline]
    model Control, harness Control_Harness1, mode Software-in-the-Loop (SIL)

  case "Test Case 3 Unit Test BackToBack Control" [equivalence]
    simulation 1:
      model Control, harness Control_Harness1, mode Normal
    simulation 2:
      model Control, harness Control_Harness1, mode Software-in-the-Loop (SIL)
    equivalence criteria
      Mode: rel tol 0.001
      v: rel tol 0.001
      w: rel tol 0.001

  case "Test Case 4 Integration Test Scenario1" [simulation]
    model StraddleCarrier
    post-load callback:
      set(rrSim, SimulationCommand = "Start")
      while strcmp(rrSim.get("SimulationStatus"), "Running")
          pause(1)
      end
    assessment "Assessment1": At any point of time, distance must be greater than 15
      distance: signal StraddleCarrier/Autonomous Emergency Brake, port 2

  case "Test Case 5 Integration Test Scenario2" [simulation]
    model StraddleCarrier
    post-load callback: same code as in post-load callback of case "Test Case 4 Integration Test Scenario1"
    assessment "Assessment1": At any point of time, distance must be greater than 15
      distance: signal StraddleCarrier/Autonomous Emergency Brake, port 2

  case "Test Case 6 Integration Test Scenario3" [simulation]
    model StraddleCarrier
    post-load callback: same code as in post-load callback of case "Test Case 4 Integration Test Scenario1"
    assessment "Assessment1": At any point of time, distance must be greater than 15
      distance: signal StraddleCarrier/Autonomous Emergency Brake, port 2